# Grasshopper definition check_trajectories_rhino.gh (Grasshopper 1.0.7)

path = FilePath("C:\Users\rb1619\Documents\GitHub\track_pedestrian\video1\tracking_data_per_user_resampled.csv")
path_2 = FilePath("C:\Users\rb1619\Documents\GitHub\track_pedestrian\video1\tracking_data_per_user_kalman.csv")
panel = Panel(path)
coords = ImportCoordinates(File=path, Separator=",", XIndex=3, YIndex=4, ZIndex=1)
coords_2 = ImportCoordinates(File=path_2, Separator=",", XIndex=3, YIndex=4, ZIndex=1)
move = Move(Geometry=coords, Motion=Vector(-0.6781149561, 18.70871147, 0))  # -> Geometry, Transform
pdecon = Deconstruct(Point=coords_2)  # -> XComponent, YComponent, ZComponent
pdecon_2 = Deconstruct(Point=move.Geometry)  # -> XComponent, YComponent, ZComponent
cset = CreateSet(List=pdecon.ZComponent)  # -> Set, graft(Map)
pt = ConstructPoint(XCoordinate=pdecon.XComponent, YCoordinate=pdecon.YComponent, ZCoordinate=0)  # -> graft(Point)
cset_2 = CreateSet(List=pdecon_2.ZComponent)  # -> Set, graft(Map)
pt_2 = ConstructPoint(XCoordinate=pdecon_2.XComponent, YCoordinate=pdecon_2.YComponent, ZCoordinate=0)  # -> graft(Point)
viewer = ParamViewer(cset.Map)
viewer_2 = ParamViewer(cset_2.Map)
path_3 = ConstructPath(Indices=cset.Map)  # -> flatten(Branch)
path_4 = ConstructPath(Indices=cset_2.Map)  # -> flatten(Branch)
replace = ReplacePaths(Data=pt, Search=viewer, Replace=path_3)
replace_2 = ReplacePaths(Data=pt_2, Search=viewer_2, Replace=path_4)
number_slider = Slider(25, range=0..50)
pline = PolyLine(Vertices=replace, Closed=False)
item = ListItem(List=replace, Index=0, Wrap=True)
pline_2 = PolyLine(Vertices=replace_2, Closed=False)
item_2 = ListItem(List=replace_2, Index=0, Wrap=True)
panel_2 = Panel(replace_2)
branch = TreeBranch(Tree=replace, Path=number_slider, MaintainPaths=True)
branch_2 = TreeBranch(Tree=item, Path=number_slider, MaintainPaths=True)
branch_3 = TreeBranch(Tree=pline, Path=number_slider, MaintainPaths=True)
branch_4 = TreeBranch(Tree=replace_2, Path=number_slider, MaintainPaths=True)
branch_5 = TreeBranch(Tree=item_2, Path=number_slider, MaintainPaths=True)
branch_6 = TreeBranch(Tree=pline_2, Path=number_slider, MaintainPaths=True)
points = PointList(Points=branch_4, Size=0.5)
points_2 = PointList(Points=branch, Size=0.5)
